# Grasshopper definition FileInput.gh (Grasshopper 1.0.4)

brep = Brep(<brep referenced from the Rhino model>)
debrep = DeconstructBrep(Brep=brep)  # -> Faces, Edges, Vertices
cp = ControlPoints(Curve=debrep.Faces)  # -> Points, Weights, Knots
bbox = BoundingBox(Content=brep, Plane=PlaneXY(0, 0, 0))  # -> Box, Box_2
lng = ListLength(List=cp.Points)  # -> flatten(Length)
debox = DeconstructBox(Box=bbox.Box_2)  # -> Plane, X, Y, Z
dedomain = DeconstructDomain(Domain=debox.Z)  # -> Start, End
abs = Absolute(Value=dedomain.End)
equals = Equality(FirstNumber=lng, SecondNumber=Slider(7, range=0..10))  # -> Equality, Inequality
pt = ConstructPoint(XCoordinate=0, YCoordinate=0, ZCoordinate=0)
pt_2 = ConstructPoint(XCoordinate=0, YCoordinate=0, ZCoordinate=abs)
cull = CullPattern(List=debrep.Faces, CullPattern=equals.Equality)
pcen = PolygonCenter(Polyline=cull)  # -> simplify(CenterV), CenterE, CenterA
facen = FaceNormals(Mesh=cull)  # -> flatten(Centers), flatten(Normals)
ln = Line(StartPoint=pt, EndPoint=pt_2)
eval = EvaluateCurve(Curve=ln, Parameter=Slider(0.5, range=0..1))  # -> Point, Tangent, Angle
cull_2 = CullPattern(List=facen.Normals, CullPattern=[False, True])
pl = PlaneNormal(Origin=pcen.CenterV, ZAxis=cull_2)  # -> simplify(Plane)
pdecon = Deconstruct(Point=eval.Point)  # -> XComponent, YComponent, ZComponent
pdecon_2 = Deconstruct(Point=pl)  # -> XComponent, YComponent, ZComponent
ln_2 = Line(StartPoint=pl, EndPoint=eval.Point)
panel = Panel(ln_2)
subtraction = Subtraction(A=pdecon.XComponent, B=pdecon_2.XComponent)  # -> flatten(Result)
subtraction_2 = Subtraction(A=pdecon_2.YComponent, B=pdecon.YComponent)  # -> flatten(Result)
subtraction_3 = Subtraction(A=pdecon_2.ZComponent, B=pdecon.ZComponent)  # -> flatten(Result)
abs_2 = Absolute(Value=subtraction)
timer = Timer(TimerInterval=5000, Target=deconstructstinginput)
deconstructstinginput = GhPythonScript(inputURL="http://maxiemgeldhof.com/node/raw")  # -> out, simplify(idOutput), simplify(pointOutput)
# ---------- deconstructstinginput: Python ----------
import rhinoscriptsyntax as rs
import re
import urllib2
import time
start = time.time()
distanceX = [0.,40.,40.,0.,0.,-40.,-40.,0.]
distanceY = [40.,0.,0.,40.,-40.,0.,0.,-40.]
distanceZ = [28.284271,28.284271,-28.284271,-28.284271,28.284271,28.284271,-28.284271,-28.284271]
response = urllib2.urlopen("http://maxiemgeldhof.com/node/raw")
text = response.read()
response.close()
print(time.time() - start)
distanceX = [x*2 for x in distanceX]
distanceY = [x*2 for x in distanceY]
distanceZ = [x*2 for x in distanceZ]

arrNodes = []
arrFaces = []
text = re.sub(";", "\n", text)
for line in text.split():
    id = int(re.sub(":.*", "", line))
    line = re.sub("^[0-9]*:", "", line)
    surrounding = []
    for number in re.sub(",", " ", line).split():
        surrounding.append(int(number))
    arrNodes.append(id)
    arrFaces.append(surrounding)
print(time.time() - start)

#______________________________________________

class Node:
    x=None
    y=None
    z=None
    id=None
    surrounding = []
    def __init__(self,surrounding, id):
        self.surrounding = surrounding
        self.id = id

    def getCoord(self):
        return self.x, self.y, self.z

    def sharePos(self,x,y,z):
        if self.x is None:
            self.x = x
            self.y = y
            self.z = z
            for index, node in enumerate(self.surrounding):
                if node != 0:
                #self.array = [0,0,0,0,0,0,0,0]
                    #self.array[index] += 1
                    self.move = [distanceX[index], distanceY[index], distanceZ[index]]
                     
                    getObj(node).sharePos(self.x + self.move[0], self.y + self.move[1], self.z + self.move[2])


def getObj(id):
    for node in nodes:
        if node.id == id:
            return node


def calcspots():
    nodes[0].sharePos(0., 0., 0.)

nodes = [Node(surrounding, id) for surrounding, id in zip(arrFaces, arrNodes)]
calcspots()
print(time.time() - start)
idOutput = []
pointOutput = []
for node in nodes:
    idOutput.append(node.id)
    pointOutput.append(rs.AddPoint(node.x, node.y, node.z))
print(time.time() - start)
# ---------- end deconstructstinginput ----------
panel_2 = Panel(subtraction_2)
panel_3 = Panel(abs_2)
panel_4 = Panel(subtraction_3)
panel_5 = Panel(deconstructstinginput.idOutput)
panel_6 = Panel(deconstructstinginput.out)
panel_7 = Panel(deconstructstinginput.pointOutput)
vec = Vector(deconstructstinginput.pointOutput)
move = Move(Geometry=brep, Motion=vec)  # -> Geometry, Transform
